# Grasshopper definition test.gh (Grasshopper 1.0.7)
# plug-ins: Transfinite

panel = Panel("132.191 109.775 3.38065 123.46 116.194 11.2296 108.597 127.461 21.0665 92.0275 137.526 13.0152 83.9708 142.896 8.24165")
panel_2 = Panel("83.9708 142.896 8.24165 56.2923 127.796 9.87244 24.0174 118.532 8.4064 -7.25685 116.377 5.19098")
panel_3 = Panel("100 -100 0 99.065 -68.6247 -0.632911 101.652 -15.9413 -0.711095 115.079 54.0322 1.48612 126.276 92.4937 3.66448 132.191 109.775 3.38065")
panel_4 = Panel("0.019329 11.8409 8.48475 13.1342 12.0097 8.47983 51.8205 -2.19188 8.49852 58.3194 -57.8379 8.16055 55.7628 -90.3898 8.64392 53.9182 -100 8.47485")
panel_5 = Panel("-7.25685 116.377 5.19098 -6.20675 98.9834 18.6448 -4.03982 64.015 31.614 -0.726455 28.2153 16.9218 0.019329 11.8409 8.48475")
panel_6 = Panel("53.9182 -100 8.47485 61.3858 -99.653 11.4727 79.049 -100.186 15.9436 93.0327 -100 7.21678 100 -100 0")
bang = ExplodeTree()  # -> Branch0, Branch1, Branch2, Branch3, Branch4, Branch5, Branch6, Branch7, Branch8, Branch9
cluster = Cluster(pt=panel, K="0 0 0 0.545052 1 1 1")  # -> pt_3, K_2
cluster_2 = Cluster(pt=panel_2, K="0 0 0 1 1 1")  # -> pt_3, K_2
cluster_3 = Cluster(pt=panel_5, K="0 0 0 0.518535 1 1 1")  # -> pt_3, K_2
cluster_4 = Cluster(pt=panel_4, K="0 0 0 0.270352 0.795435 1 1 1")  # -> pt_3, K_2
cluster_5 = Cluster(pt=panel_6, K="0 0 0 0.482422 1 1 1")  # -> pt_3, K_2
cluster_6 = Cluster(pt=panel_3, K="0 0 0 0.437553 0.74263 1 1 1")  # -> pt_3, K_2
nurbcrv = NurbsCurvePWK(Points=flatten(cluster_4.pt_3), Knots=cluster_4.K_2)  # -> Curve, Length, Domain
nurbcrv_2 = NurbsCurvePWK(Points=flatten(cluster.pt_3), Knots=cluster.K_2)  # -> Curve, Length, Domain
nurbcrv_3 = NurbsCurvePWK(Points=flatten(cluster_2.pt_3), Knots=cluster_2.K_2)  # -> Curve, Length, Domain
nurbcrv_4 = NurbsCurvePWK(Points=flatten(cluster_3.pt_3), Knots=cluster_3.K_2)  # -> Curve, Length, Domain
nurbcrv_5 = NurbsCurvePWK(Points=flatten(cluster_5.pt_3), Knots=cluster_5.K_2)  # -> Curve, Length, Domain
nurbcrv_6 = NurbsCurvePWK(Points=flatten(cluster_6.pt_3), Knots=cluster_6.K_2)  # -> Curve, Length, Domain
panel_7 = Panel("""0.3
0.6""")
num = Number(panel_7)
shatter = Shatter(Curve=nurbcrv.Curve, Parameters="0.5")
flatten = FlattenTree(Tree=shatter, Path="{0;0}")
neg = Negative(Value=Slider(65, range=0..100))
merge = Merge(
    Data1=nurbcrv_2.Curve,
    Data2=nurbcrv_3.Curve,
    Data3=nurbcrv_4.Curve,
    Data4=nurbcrv.Curve,
    Data5=nurbcrv_5.Curve,
    Data6=nurbcrv_6.Curve)
X = UnitX(Factor=neg)
move = Move(Geometry=merge, Motion=X)  # -> Geometry, Transform
cluster_7 = Cluster_3(C=graft(move.Geometry))  # -> P, V
unit = UnitVector(Vector=cluster_7.V)
multiplication = Multiplication(A=unit, B=Slider(37, range=0..100))
neg_2 = Negative(Value=multiplication)
list = ValueList({"Harmonic Point": 3, "Radial Distance Function": 4}, selected="Harmonic Point")
cluster_8 = Cluster_2(C=move.Geometry)  # -> O, R
list_2 = ValueList({"Special Side Blending": 2}, selected="Special Side Blending")
list_3 = ValueList({"Regular Domain": 0, "Concave Domain": 1, "Curved Domain": 2}, selected="Curved Domain")
vdis = VectorDisplay(Anchor=cluster_7.P, Vector=neg_2)
neg_3 = Negative(Value=cluster_8.R)
nickname = RibbonTest(Curves=move.Geometry)  # -> M, M2, Rc, Rv
vdis_2 = VectorDisplay(Anchor=cluster_8.O, Vector=neg_3)
transfinite = TransfiniteSurface(Curves=move.Geometry, DomainType=list_3, Parametrization=list, Blending=list_2)  # -> Model, DomainC, DomainV, DomainMesh, RibbonVector, RibbonCenter, RibbonVector_2
deplane = DeconstructPlane(Plane=transfinite.RibbonVector)  # -> Origin, XAxis, YAxis, ZAxis
bang_2 = ExplodeTree(Data=transfinite.RibbonVector_2)  # -> Branch0, Branch1, Branch2, Branch3, Branch4
pt = Point(nickname.Rc)
multiplication_2 = Multiplication(A=deplane.XAxis, B=Slider(20, range=0..100))
addition = Addition(A=deplane.Origin, B=multiplication_2)
demesh = DeconstructMesh(Mesh=transfinite.DomainMesh)  # -> Vertices, Faces, Colours, Normals
unit_2 = UnitVector(Vector=transfinite.RibbonVector_2)
swatch = ColourSwatch(SwatchColor=RGB(255, 31, 31))
demesh_2 = DeconstructMesh(Mesh=transfinite.Model)  # -> Vertices, Faces, Colours, Normals
harmonic = Harmonic(Input=bang_2.Branch1)  # -> Pts, Values
vdis_3 = VectorDisplay(Anchor=pt, Vector=nickname.Rv)
demesh_3 = DeconstructMesh(Mesh=nickname.M)  # -> Vertices, Faces, Colours, Normals
pt_2 = Point(addition)
vdis_4 = VectorDisplay(Anchor=deplane.Origin, Vector=multiplication_2)
conmesh = ConstructMesh(Vertices=demesh_2.Vertices, Faces=demesh_2.Faces)
conmesh_2 = ConstructMesh(Vertices=demesh.Vertices, Faces=demesh.Faces)
demesh_4 = DeconstructMesh(Mesh=nickname.M2)  # -> Vertices, Faces, Colours, Normals
ln = Line(StartPoint=deplane.Origin, EndPoint=pt_2)
rgb = ColourRGB(Alpha=255, Red=harmonic.Values, Green=harmonic.Values, Blue=harmonic.Values)
preview = CustomPreview(Geometry=conmesh, Material=ColourSwatch(SwatchColor=RGB(0, 255, 0)))
medges = MeshEdges(Mesh=conmesh)  # -> NakedEdges, InteriorEdges, NonManifoldEdges
preview_2 = CustomPreview(Geometry=conmesh_2, Material=ColourSwatch(SwatchColor=RGB(255, 255, 255)))
conmesh_3 = ConstructMesh(Vertices=demesh_3.Vertices, Faces=demesh_3.Faces, Colours=ColourSwatch(SwatchColor=RGB(2, 101, 250)))
dots = DotDisplay(Point=harmonic.Pts, Colour=rgb, Size=Slider(2, range=0..5))
conmesh_4 = ConstructMesh(Vertices=demesh_4.Vertices, Faces=demesh_4.Faces)
multiplication_3 = Multiplication(A=unit_2, B=10)
medges_2 = MeshEdges(Mesh=transfinite.DomainMesh)  # -> NakedEdges, InteriorEdges, NonManifoldEdges
vdis_5 = VectorDisplay(Anchor=transfinite.RibbonCenter, Vector=multiplication_3)
item = ListItem(List=transfinite.DomainV, Index=Slider(0, range=0..6), Wrap=True)
pt_3 = Point(Point(132.191, 109.775, 3.38065))
pt_4 = Point(Point(132.658717, 110.2220307, 3.032090845))
panel_8 = Panel(item)
panel_9 = Panel(pt_3)
panel_10 = Panel(pt_4)

# ==== cluster Cluster
K = ClusterInput()  # K
pt = ClusterInput()  # Pt
split = TextSplit(Text=pt, Separators=" ")
split_2 = TextSplit(Text=K, Separators=" ")
partition = PartitionList(List=split, Size=3)
item = ListItem(List=partition, Index=0, Wrap=True)  # -> Item, Item1, Item2
pt_2 = ConstructPoint(XCoordinate=item.Item, YCoordinate=item.Item1, ZCoordinate=item.Item2)
K_2 = ClusterOutput(split_2)  # K
pt_3 = ClusterOutput(pt_2)  # Pt

# ==== cluster Cluster_2
C = ClusterInput()
range = Range(Domain=Domain(0, 1), Steps=Slider(20, range=0..100))
hframe = HorizontalFrame()
cdiv = Derivatives(Curve=reparameterize(graft(C)), Parameter=range)  # -> Point, FirstDerivative
pframe = PerpFrame(Curve=reparameterize(graft(C)), Parameter=range)
pl = PlaneNormal(Origin=cdiv.Point, ZAxis=cdiv.FirstDerivative)
deplane = DeconstructPlane(Plane=pframe)  # -> Origin, XAxis, YAxis, ZAxis
multiplication = Multiplication(A=deplane.XAxis, B=Slider(50, range=0..100))
vdis = VectorDisplay(Anchor=deplane.Origin, Vector=multiplication)
R = ClusterOutput(multiplication)
O = ClusterOutput(deplane.Origin)

# ==== cluster Cluster_3
range = Range(Domain=Domain(0, 1), Steps=10)
addition = Addition(A=range, B=0.001)
C = ClusterInput()
cdiv = Derivatives(Curve=C, Parameter=addition)  # -> Point, FirstDerivative
cdiv_2 = Derivatives(Curve=C, Parameter=range)  # -> Point, FirstDerivative
xprod = CrossProduct(VectorA=cdiv_2.FirstDerivative, VectorB=cdiv.FirstDerivative, Unitize=False)  # -> Vector, Length
P = ClusterOutput(cdiv_2.Point)
xprod_2 = CrossProduct(VectorA=xprod.Vector, VectorB=cdiv_2.FirstDerivative, Unitize=False)  # -> Vector, Length
V = ClusterOutput(xprod_2.Vector)
